# Grasshopper definition YTP_re.gh (Grasshopper 1.0.4)

path = FilePath("\\Mac\Home\Downloads\links.csv")
path_2 = FilePath("\\Mac\Home\Downloads\labels.csv")
file = ReadFile(File=path_2, PerLineParse=True)
file_2 = ReadFile(File=path, PerLineParse=True)
split = TextSplit(Text=file, Separators=",")
panel = Panel(split)
flip = FlipMatrix(Data=split)
cull_i = CullIndex(List=flip, Indices="0", Wrap=True)
rep = ReplaceText(Text=cull_i, Find="\"", RecursiveReplace=False)
rep_2 = ReplaceText(Text=rep, Find="[", RecursiveReplace=False)
rep_3 = ReplaceText(Text=rep_2, Find="]", RecursiveReplace=False)
split_2 = TextSplit(Text=file_2, Separators=",")  # -> simplify(Result)
flip_2 = FlipMatrix(Data=split_2)  # -> simplify(Data)
cull_i_2 = CullIndex(List=flip_2, Indices="0", Wrap=True)
bang = ExplodeTree(Data=cull_i_2)  # -> simplify(Branch0), simplify(Branch1), simplify(Branch2), simplify(Branch3), simplify(graft(Branch4)), simplify(graft(Branch5))
bang_2 = ExplodeTree(Data=simplify(rep_3))  # -> Branch0, Branch1, Branch2, simplify(graft(Branch3)), Branch4, Branch5, Branch6
panel_2 = Panel(bang_2.Branch0)
panel_3 = Panel(bang.Branch4)
panel_4 = Panel(bang.Branch5)
panel_5 = Panel(bang.Branch0)
panel_6 = Panel(bang_2.Branch1)

# ---- group: Tag Data Reading
path_3 = FilePath("\\Mac\Home\Downloads\nodes.csv")
file_3 = ReadFile(File=path_3, PerLineParse=True)  # -> flatten(Content)
split_3 = TextSplit(Text=file_3, Separators=",")
flip_3 = FlipMatrix(Data=split_3)  # -> simplify(Data)
cull_i_3 = CullIndex(List=flip_3, Indices="0", Wrap=True)
bang_3 = ExplodeTree(Data=cull_i_3)  # -> simplify(graft(Branch0)), simplify(graft(Branch1)), simplify(graft(Branch2)), simplify(graft(Branch3)), simplify(graft(Branch4)), simplify(graft(Branch5)), simplify(graft(Branch6)), simplify(graft(Branch7))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

# ----
panel_7 = Panel(bang_2.Branch2)
panel_8 = Panel(bang_2.Branch3)
panel_9 = Panel(bang_2.Branch4)
panel_10 = Panel(bang_2.Branch5)
panel_11 = Panel(bang_2.Branch6)
ahsv = SplitAHSV()  # -> Alpha, Hue, Saturation, Value
python = GhPythonScript(x=bang_3.Branch7, y=Slider(0.1, range=0..0.1))  # -> a
# ---------- python: Python ----------
__author__ = "Akihito TAKEUCHI"
__version__ = "2018.05.11"

import rhinoscriptsyntax as rs

if x == "0":
    a = y
else: a = x
# ---------- end python ----------

# ---- group: Center Point / Center Point Data Reading
path_4 = FilePath("\\Mac\Home\Desktop\takeuchi.csv")
file_4 = ReadFile(File=path_4, PerLineParse=True)  # -> flatten(Content)
split_4 = TextSplit(Text=file_4, Separators=",")
flip_4 = FlipMatrix(Data=split_4)  # -> simplify(Data)

# ----
cull_i_4 = CullIndex(List=flip_4, Indices="0", Wrap=True)

# ---- group: Center Point / Center Point Data Reading (continued)
bang_4 = ExplodeTree(Data=cull_i_4)  # -> simplify(graft(Branch0)), simplify(graft(Branch1)), simplify(graft(Branch2)), simplify(graft(Branch3))

# ---- group: Center Point / Center Point Scaling
number_slider = Slider(10000, range=0..10000)
multiplication = Multiplication(A=bang_4.Branch3, B=number_slider)
multiplication_2 = Multiplication(A=bang_4.Branch2, B=number_slider)
multiplication_3 = Multiplication(A=bang_4.Branch1, B=number_slider)

# ----
flatten = FlattenTree(Tree=multiplication_3, Path="{0}")
flatten_2 = FlattenTree(Tree=multiplication_2, Path="{0}")
flatten_3 = FlattenTree(Tree=multiplication, Path="{0}")

# ---- group: Center Point
pt = ConstructPoint(XCoordinate=multiplication_3, YCoordinate=multiplication_2, ZCoordinate=multiplication)

# ----
item = ListItem(List=flatten, Index=bang.Branch4, Wrap=True)
item_2 = ListItem(List=flatten_2, Index=bang.Branch4, Wrap=True)
item_3 = ListItem(List=flatten_3, Index=bang.Branch4, Wrap=True)
item_4 = ListItem(List=flatten, Index=bang.Branch5, Wrap=True)
item_5 = ListItem(List=flatten_2, Index=bang.Branch5, Wrap=True)
item_6 = ListItem(List=flatten_3, Index=bang.Branch5, Wrap=True)
pt_2 = ConstructPoint(XCoordinate=item, YCoordinate=item_2, ZCoordinate=item_3)
pt_3 = ConstructPoint(XCoordinate=item_4, YCoordinate=item_5, ZCoordinate=item_6)
panel_12 = Panel(pt_3)
ln = Line(StartPoint=pt_2, EndPoint=pt_3)
preview = CustomPreview(Geometry=ln, Material=ColourSwatch(SwatchColor=RGBA(204, 204, 204, 30)))

# ---- group: Making Spere
multiplication_4 = Multiplication(A=number_slider, B=Slider(0.04, range=0..1))

# ----
division = Division(A=multiplication_4, B=python)

# ---- group: Making Spere (continued)
sph = Sphere(Base=pt, Radius=division)

# ----
multiplication_5 = Multiplication(A=division, B=Slider(0.1, range=0..1))
tag = TextTag3D(
    Location=pt,
    Text=bang_3.Branch1,
    Size=multiplication_5,
    Colour=ColourSwatch(SwatchColor=RGB(255, 255, 255)),
    Justification=Slider(5, range=0..10))
preview_2 = CustomPreview(Geometry=sph, Material=ColourSwatch(SwatchColor=RGBA(53, 94, 156, 100)))
